# Grasshopper definition basket.gh (Grasshopper 1.0.7)

# ----
# Bottom holes for fabrics to go through
number_slider = Slider(2, range=0..50)
crv = Curve(<curve referenced from the Rhino model>)
arrpolar = PolarArray(Geometry=crv, Plane=PlaneXY(0, 0, 0), Count=number_slider, Angle=6.283185307)  # -> Geometry, Transform
vec = VectorXYZ(XComponent=0, YComponent=0, ZComponent=Slider(11, range=0..50))  # -> Vector, Length
srf = Surface(arrpolar.Geometry)
extr = Extrude(Base=srf, Direction=vec.Vector)

# ----
# Create revolved surface
# Edit this curve to fit the water container.
# Make sure the curve is inside a rectangular
# of max opening width X max depth
pt = ConstructPoint(XCoordinate=0, YCoordinate=0, ZCoordinate=10)
# Self-watering Pot System
# Mengjia Zhu, Final Project, MAT 594X, Computational Fabrication, Spring 2020
# 
# This program allows you to generate the inner basket for the self-watering pot system.
# To use the program, you only need to draw a curve as input (green block),
# and define a point on the edge for hanging structure (optional, yellow block).
pt_2 = ConstructPoint(XCoordinate=0, YCoordinate=0, ZCoordinate=0)
crv_2 = Curve(<curve referenced from the Rhino model>)
ln = Line(StartPoint=pt_2, EndPoint=pt)
revsrf = Revolution(Curve=crv_2, Axis=ln, Domain=Domain(0, 6.283185307))

# ----
# Wall pattern generator
number_slider_2 = Slider(15, range=0..50)
geo = Geometry(<curve referenced from the Rhino model>)
geo_2 = Geometry(<curve referenced from the Rhino model>)
vec_2 = VectorXYZ(XComponent=number_slider_2, YComponent=0, ZComponent=0)  # -> Vector, Length
arrlinear = LinearArray(Geometry=geo, Direction=vec_2.Vector, Count=Slider(15, range=0..50))  # -> Geometry, Transform
vec_3 = VectorXYZ(XComponent=0, YComponent=0, ZComponent=Slider(1, range=0..5))  # -> Vector, Length
boundary = BoundarySurfaces(Edges=geo_2)
srf_2 = Surface(arrlinear.Geometry)
extr_2 = Extrude(Base=boundary, Direction=vec_3.Vector)
extr_3 = Extrude(Base=srf_2, Direction=vec_3.Vector)
sdiff = SolidDifference(BrepsA=extr_2, BrepsB=extr_3)
bbox = BoundingBox(Content=sdiff, Plane=PlaneXY(0, 0, 0), UnionBox=True)  # -> Box, Box_2
srfmorph = SurfaceMorph(
    Geometry=sdiff,
    Reference=bbox.Box,
    Surface=reparameterize(revsrf),
    UDomain=Slider(1, range=0..5),
    VDomain=Slider(1, range=0..5),
    WDomain=Slider(-2, range=-5..6))

# ----
# This is a point
# from the curve.
# Do not remove
# this point.
pt_3 = Point(Point(43.48822357, 0, 116.0447353))

# ----
# Top edge structures for hanging
number_slider_3 = Slider(4, range=0..20)
xy = XYPlane(Origin=Point(0, 0, 0))
pdecon = Deconstruct(Point=pt_3)  # -> XComponent, YComponent, ZComponent
sph = Sphere(Base=PlaneXY(0, 0, 0), Radius=number_slider_3)
pl_offset = PlaneOffset(BasePlane=xy, Offset=pdecon.ZComponent)
cir = Circle(Plane=pl_offset, Radius=pdecon.XComponent)
movetoplane = MoveToPlane(Geometry=sph, Plane=pl_offset, Above=True, Below=True)  # -> Geometry, Transform
vec_4 = VectorXYZ(XComponent=pdecon.XComponent, YComponent=0, ZComponent=0)  # -> Vector, Length
move = Move(Geometry=movetoplane.Geometry, Motion=vec_4.Vector)  # -> Geometry, Transform
arrcurve = CurveArray(Geometry=move.Geometry, Curve=cir, Count=Slider(38, range=0..100))  # -> Geometry, Transform
sunion = SolidUnion(Breps=arrcurve.Geometry)

panel = Panel(revsrf)

# ----
# Boolean parts together
trim = TrimSolid(Shape=srfmorph, Cutters=extr)
sunion_2 = SolidUnion(Breps=[trim, sunion])

panel_2 = Panel(srfmorph)
